# Grasshopper definition SiteModelKiller_example_for_v2.01.gh (Grasshopper 1.0.7)
# plug-ins: SiteModelKiller

m = Slider(3, range=0..10)
m_2 = Slider(2.3, range=0..10)
m_3 = Slider(1.9, range=0..10)
底座_線框或平面 = Geometry(<curve referenced from the Rhino model>)
建築量體邊界 = Curve([<curve referenced from the Rhino model> x3])
標示_文字 = Guid([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])
量體 = Brep([<brep referenced from the Rhino model> x2])
parapets_generator = ParapetsGenerator(Buildings=量體, ParapetHeight=m_3, ParapetWidth=m_2, IncludeBuilding=Toggle(False))
ghcbuildinggenerator = GhcBuildingGenerator(Text=標示_文字, BuildingCrvs=建築量體邊界, FloorHeight=m, BaseFrame=底座_線框或平面)
brep = Brep(parapets_generator)
brep_2 = Brep(ghcbuildinggenerator)
